# Grasshopper definition full-solution.gh (Grasshopper 1.0.7)
# plug-ins: Triceratops, Swiftlet, LunchBox, Heteroptera, Pufferfish, MeshEdit Components, eleFront

curve = Curve(<curve referenced from the Rhino model>)
offset_curve = OffsetCurve(Curve=curve, Distance=Slider(1000, range=0..1000), Corners=1)
fillet = Fillet(Curve=offset_curve, Radius=Slider(1000, range=0..1000))
brep = Brep([<brep referenced from the Rhino model> x4])
number_slider = Slider(10000, range=0..10000)
brep_join = BrepJoin(Breps=brep)  # -> Breps, Closed
file_path = FilePath("D:\04_Projects\ucl-grasshopper-web\assets\GRC_Athens.167160_IWEC.epw")
unit_z = UnitZ(Factor="13000")
extrude = Extrude(Base=fillet, Direction=unit_z)
importepw = LBImportEPW(epw_file=file_path)  # -> location, dry_bulb_temperature, dew_point_temperature, relative_humidity, wind_speed, wind_direction, direct_normal_rad, diffuse_horizontal_rad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; plug-in component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
reference_by_layer = ReferenceByLayer(LayerName="context", lightweight=False, DisableAutoUpdate=False)
reverse_surface_direction = ReverseSurfaceDirection(Surface=extrude, ReverseOption=3)
flip = Flip(Surface=reverse_surface_direction)  # -> Surface, Result
relativepath = RelativePath()
panel_size = Slider(2000, range=0..2000)

# ----
# Annual Radiation
panel = Panel("90")
skymatrix = LBCumulativeSkyMatrix(
    north=panel,
    location=importepw.location,
    direct_rad=importepw.direct_normal_rad,
    diffuse_rad=importepw.diffuse_horizontal_rad)  # -> report, sky_mtx; plug-in component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

reverse_surface_direction_2 = ReverseSurfaceDirection(Surface=reverse_surface_direction, ReverseOption=3)
surface = Surface(reparameterize(flatten(reverse_surface_direction_2)))
dimensions = Dimensions(Surface=surface)  # -> UDimension, VDimension
multiplication = Multiplication(A=panel_size, B="0.866")
subtraction = Subtraction(B=0.5)
merge = Merge(Data1=reference_by_layer, Data2=brep_join.Breps)
mesh = Mesh(reference_by_layer)

# ---- group: Get the shattered dimensions for the centered panels
shatter_parameters = ShatterParameters(dimension=dimensions.UDimension, size=panel_size)  # -> floor, result
shatter_parameters_2 = ShatterParameters(dimension=dimensions.VDimension, size=multiplication)  # -> floor, result

# ----
# Visualize Sky Matrix
skydome = LBSkyDome(sky_mtx=skymatrix.sky_mtx, scale=Slider(0.5, range=0..1))  # -> report, mesh, compass, legend, title, patch_vecs, patch_values, mesh_values, vis_set; plug-in component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

# ----
# Get your API key at
# https://platform.openai.com/account/api-keys
api_key = Panel("YOUR API KEY HERE")  # disabled

model = Panel("gpt-3.5-turbo")  # disabled
temperature = Slider(0.7, range=0..1)  # disabled
prompt = Panel("Why did the chicken cross the road?")  # disabled
role = Panel("user")  # disabled
cjv = CreateJSONValue(Value=role)  # disabled
cjv_2 = CreateJSONValue(Value=prompt)  # disabled
keys = Panel("""role
content""")  # disabled
merge_2 = Merge(Data1=cjv, Data2=cjv_2)  # disabled
cjo = CreateJSONObject(Keys=keys, Values=merge_2)  # disabled
keys_2 = Panel("""model
messages
temperature""")  # disabled
cja = CreateJSONArray(JTokens=cjo)  # disabled
cjv_3 = CreateJSONValue(Value=model)  # disabled
cjv_4 = CreateJSONValue(Value=temperature)  # disabled
merge_3 = Merge(Data1=cjv_3, Data2=cja, Data3=cjv_4)  # disabled
text_completion_url = Panel("https://api.openai.com/v1/chat/completions")  # disabled
cjo_2 = CreateJSONObject(Keys=keys_2, Values=merge_3)  # disabled
ctb = CreateTextBody(
    Content=cjo_2,
    IsHtmlChecked=False,
    IsJavascriptChecked=False,
    IsJsonChecked=True,
    IsTextChecked=False,
    IsXmlChecked=False)  # disabled
bearer = BearerTokenAuth(Token=api_key)  # disabled
post = POSTRequest(URL=text_completion_url, Body=ctb, Headers=bearer)  # -> Status, Content, Response; disabled
pjs = ParseJSONString(Text=post.Content)  # disabled
panel_2 = Panel("choices")  # disabled
gjok = GetJSONObjectKey(JObject=pjs, Key=panel_2)  # disabled
panel_3 = Panel("message")  # disabled
rja = ReadJSONArray(Array=gjok)  # disabled
panel_4 = Panel("content")  # disabled
gjok_2 = GetJSONObjectKey(JObject=rja, Key=panel_3)  # disabled
gjok_3 = GetJSONObjectKey(JObject=gjok_2, Key=panel_4)  # disabled
rjv = ReadJSONValue(JValue=gjok_3)  # -> AsString, AsNumber, AsBool; disabled
response = Panel(rjv.AsString)  # disabled

mesh_join = MeshJoin(Meshes=mesh)
mesh_2 = Mesh(merge)
mesh_join_2 = MeshJoin(Meshes=mesh_2)
mesh_3 = Mesh(skydome.mesh)  # disabled
working_surface = WorkingSurface(surface=surface, parameters_u=shatter_parameters.result, parameters_v=shatter_parameters_2.result)
mesh_flip = MeshFlip(Mesh=mesh_3)  # disabled
meshbasicmaterial = MeshBasicMaterial(Color=RGB(255, 255, 255))  # disabled
meshstandardmaterial = MeshStandardMaterial(
    Color=ColourSwatch(SwatchColor=RGB(255, 255, 255)),
    Opacity="0",
    Roughness=1,
    Metalness=0.5,
    Emissive=RGB(0, 0, 0),
    EmissiveIntensity=1)
grid_layout = GridLayout(surface=working_surface, u_divisions=shatter_parameters.floor, v_divisions=shatter_parameters_2.floor)  # -> graft(renumbered_data)

surface_2 = Surface(grid_layout)
deconstruct_plane = DeconstructPlane(Plane=surface_2)  # -> Origin, XAxis, YAxis, ZAxis
amplitude = Amplitude(Vector=deconstruct_plane.ZAxis, Amplitude="500")
extrude_2 = Extrude(Base=surface_2, Direction=amplitude)

simple_mesh = SimpleMesh(Brep=grid_layout)  # -> flatten(Mesh)
simple_mesh_2 = SimpleMesh(Brep=extrude_2)  # -> flatten(Mesh)
list_length = ListLength(List=simple_mesh)

# ----
# Run Radiation Study
geo = Geometry(mesh_join_2)
geo_2 = Geometry(simple_mesh)
incidentradiation = LBIncidentRadiation(
    sky_mtx=skymatrix.sky_mtx,
    geometry=flatten(geo_2),
    context=flatten(geo),
    grid_size="1",
    offset_dist="0.1",
    run=Toggle(True))  # -> report, points, results, total, mesh, legend, title, int_mtx; plug-in component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

number = Number(incidentradiation.results)
mesh_4 = Mesh(incidentradiation.mesh)
meshvertexcolors = MeshVertexColors(Mesh=mesh_flip, Material=meshbasicmaterial, DecimalAccuracy=3)  # disabled
surface_3 = Surface(reparameterize(grid_layout))
surface_4 = Surface(reparameterize(surface_3))
discontinuity = Discontinuity(Curve=surface_4, Level=1)  # -> Points, Parameters
list_item = ListItem(List=simplify(discontinuity.Points), Index=0, Wrap=True)  # -> Item, Item1, Item2
centroid = Centroid(PointA=list_item.Item, PointB=list_item.Item1, PointC=list_item.Item2)  # -> Centroid, MedianAB, MedianBC, MedianCA
surface_closest_point = SurfaceClosestPoint(Point=centroid.Centroid, Surface=surface_4)  # -> Point, UVPoint, Distance
evaluate_surface = EvaluateSurface(Surface=reparameterize(surface_4), Point=surface_closest_point.UVPoint)  # -> Point, Normal, UDirection, VDirection, Frame
brep_edges = BrepEdges(Brep=working_surface)  # -> Naked, Interior, NonManifold
number_2 = Number(number)
join_curves = JoinCurves(Curves=brep_edges.Naked, Preserve=False)
min_offset = Number(Slider(100, range=0..100))
max_offset = Number(Slider(500, range=0..1000))
construct_domain = ConstructDomain(DomainStart=min_offset, DomainEnd=max_offset)

point = Point(Point(38097.51767, -27114.87122, 10605.10783))
point_2 = Point(flatten(centroid.Centroid))
distance = Distance(PointA=point, PointB=point_2)
min_max = MinMax(Number=number_2)  # -> Minimum, Maximum
construct_domain_2 = ConstructDomain(DomainStart=0, DomainEnd=min_max.Maximum)
remap_numbers = RemapNumbers(Value=number_2, Source=construct_domain_2, Target=construct_domain)  # -> Mapped, Clipped

divide_length = DivideLength(Curve=join_curves, Length=Slider(200, range=0..1000))  # -> Points, Tangents, Parameters
brep_join_2 = BrepJoin(Breps=flatten(grid_layout))  # -> Breps, Closed
remap_numbers_2 = RemapNumbers(Value=number_2, Source=construct_domain_2, Target=Domain(0, 1))  # -> Mapped, Clipped
brep_edges_2 = BrepEdges(Brep=brep_join_2.Breps)  # -> Naked, Interior, NonManifold
length = Length(Curve=centroid.MedianCA)  # -> expr("x/4", Length)
polyline = PolyLine(Vertices=divide_length.Points, Closed=True)
linebasicmaterial = LineBasicMaterial(Color=ColourSwatch(SwatchColor=RGB(171, 171, 171)), LineWidth=Slider(0.5, range=0..1))
match_tree = MatchTree(Tree=graft(remap_numbers.Mapped), Guide=length)
match_tree_2 = MatchTree(Tree=graft(remap_numbers_2.Mapped), Guide=length)
line = Line(Line=[brep_edges_2.Naked, brep_edges_2.Interior], LineMaterial=linebasicmaterial, DecimalAccuracy=3)
height = Number(match_tree)
amplitude_2 = Amplitude(Vector=evaluate_surface.Normal, Amplitude=height)
move = Move(Geometry=centroid.Centroid, Motion=amplitude_2)  # -> Geometry, Transform
line_2 = Line(StartPoint=centroid.Centroid, EndPoint=move.Geometry)
line_3 = Line(StartPoint=move.Geometry, EndPoint=discontinuity.Points)
perp_frame = PerpFrame(Curve=reparameterize(line_2), Parameter=Slider(0.5, range=0..1))
list_item_2 = ListItem(List=line_3, Index=0, Wrap=True)  # -> Item, Item1, Item2
linebasicmaterial_2 = LineBasicMaterial(Color=ColourSwatch(SwatchColor=RGB(255, 255, 255)), LineWidth=Slider(1, range=0..10))
panel_5 = Panel(match_tree)
subtraction_2 = Subtraction(A="1", B=match_tree_2)
number_slider_2 = Slider(0.1, range=0..0.1)
number_slider_3 = Slider(4, range=0..100)
line_4 = Line(Line=polyline, LineMaterial=linebasicmaterial_2, DecimalAccuracy=3)
offset = Number(subtraction_2)

length_2 = Length(Curve=centroid.MedianCA)  # -> expr("x/4", Length)
multiplication_2 = Multiplication(A=length_2, B=offset)
offset_curve_2 = OffsetCurve(Curve=surface_4, Distance=expr("-x", multiplication_2), Corners=1)  # -> simplify(Curve)
explode = Explode(Curve=offset_curve_2, Recursive=True)  # -> reparameterize(simplify(Segments)), Vertices
curve_middle = CurveMiddle(Curve=explode.Segments)

line_5 = Line(StartPoint=move.Geometry, EndPoint=curve_middle)
list_item_3 = ListItem(List=line_5, Index=0, Wrap=True)  # -> Item, Item1, Item2
merge_4 = Merge(
    Data1=simplify(list_item_2.Item),
    Data2=simplify(list_item_3.Item),
    Data3=simplify(list_item_2.Item1),
    Data4=simplify(list_item_3.Item1),
    Data5=simplify(list_item_2.Item2),
    Data6=simplify(list_item_3.Item2))
line_plane = LinePlane(Line=merge_4, Plane=perp_frame)  # -> Point, ParamL, ParamP
clean_tree = CleanTree(RemoveNulls=True, RemoveInvalid=True, RemoveEmpty=True, Tree=line_plane.Point)
end_points = EndPoints(Curve=merge_4)  # -> Start, End
polyline_2 = PolyLine(Vertices=clean_tree, Closed=True)
polyline_3 = PolyLine(Vertices=reverse(end_points.End), Closed=True)
project = Project(Geometry=polyline_2, Plane=evaluate_surface.Frame)  # -> Geometry, Transform
merge_5 = Merge(Data1=simplify(polyline_3), Data2=simplify(polyline_2))
point_3 = Point(Point(66113.82079, 49427.97937, 42264.39656))
compatibilize_polylines = CompatibilizePolylines(Polylines=merge_5)  # -> Compatibilized, ResultBoolean
spotlight = SpotLight(
    Position=point_3,
    Color=RGB(255, 255, 255),
    Intensity=Slider(1, range=0..10),
    Angle=Slider(207, range=0..1000),
    Distance=0,
    Decay=Slider(0.1, range=0..1),
    CastShadow=True)  # -> Helper, Light
meshstandardmaterial_2 = MeshStandardMaterial(
    Color=ColourSwatch(SwatchColor=RGB(217, 217, 217)),
    Opacity=1,
    Roughness=1,
    Metalness=0.5,
    Emissive=RGB(0, 0, 0),
    EmissiveIntensity=1)
panel_6 = Panel("""corridor
toilets
kitchen
lift
stairs
units""")
panel_7 = Panel(offset)
loft = Loft(
    Curves=reparameterize(compatibilize_polylines.Compatibilized),
    Options={Adjust=True, Closed=False, LoftEnds=0, LoftSimp=0, LoftType=3, Rebuild=10, Refit=0.01})
loft_2 = Loft(
    Curves=[project.Geometry, polyline_2],
    Options={Adjust=False, Closed=False, LoftEnds=0, LoftSimp=0, LoftType=0, Rebuild=10, Refit=0.01})
panel_8 = Panel("true")
surface_split = SurfaceSplit(Surface=simplify(polyline_3), Curves=simplify(project.Geometry))
meshstandardmaterial_3 = MeshStandardMaterial(
    Color=ColourSwatch(SwatchColor=RGB(97, 97, 97)),
    Opacity=1,
    Roughness=1,
    Metalness=0.5,
    Emissive=RGB(0, 0, 0),
    EmissiveIntensity=1)
spaces = Spaces(layer=graft(panel_6))  # -> flatten(geometry)
envelope = Envelope(layer=graft("envelope"))  # -> flatten(geometry)
duplicate_data = DuplicateData(Data="solarValue", Number=list_length, Order=True)  # -> graft(Data)
duplicate_data_2 = DuplicateData(Data=number, Number=list_length, Order=True)  # -> graft(Data)
duplicate_data_3 = DuplicateData(Data="selectable", Number=list_length, Order=True)  # -> graft(Data)
hempispherelight = HempisphereLight(Color=RGB(135, 206, 250), GroundColor=RGB(210, 180, 140), Intensity=0.5)
duplicate_data_4 = DuplicateData(Data="true", Number=list_length, Order=True)  # -> graft(Data)
ambientlight = AmbientLight(Color=RGB(255, 255, 255), Intensity=0.5)
boolean_toggle = BooleanToggle(True)
list_item_4 = ListItem(List=surface_split, Index=0, Wrap=True)
merge_6 = Merge(Data1=simplify(list_item_4), Data2=simplify(loft), Data3=simplify(loft_2))
meshnormalmaterial = MeshNormalMaterial(Wireframe=False, WireframeLineJoin="round", WireframeLineWidth=1)
brep_join_3 = BrepJoin(Breps=merge_6)  # -> Breps, Closed
clean_tree_2 = CleanTree(RemoveNulls=True, RemoveInvalid=True, RemoveEmpty=True, Tree=brep_join_3.Breps)  # -> flatten(Tree)
number_3 = Number(graft(number))
number_slider_4 = Slider(10000, range=0..10000)  # disabled
panel_9 = Panel("50000")  # disabled
mesh_5 = Mesh(Mesh=flatten(mesh_join), Material=meshstandardmaterial_3, DecimalAccuracy=5)
custom_preview = CustomPreview(
    Geometry=clean_tree_2,
    Material={diffuse=RGB(221, 160, 221), emission=RGB(66, 48, 66), shine=0.5, specular=RGB(255, 255, 255), transparency=0})
userdata = UserData(Keys=[duplicate_data_3, duplicate_data], Values=[duplicate_data_4, number_3])
mesh_6 = Mesh(Mesh=graft(simple_mesh_2), Material=meshstandardmaterial, DecimalAccuracy=5, UserData=userdata)  # -> simplify(Geometry); disabled
mesh_7 = Mesh(Mesh=graft(clean_tree_2), Material=meshstandardmaterial_2, DecimalAccuracy=5, UserData=userdata)  # -> flatten(Geometry)
fog = Fog(Color=ColourSwatch(SwatchColor=RGB(0, 0, 0)), Near=Slider(646, range=0..1000), Far="80000")
construct_domain_3 = ConstructDomain(DomainStart=expr("-x", panel_9), DomainEnd=panel_9)  # disabled
meshnormalmaterial_2 = MeshNormalMaterial(Wireframe=False, WireframeLineJoin="round", WireframeLineWidth=1)
relativepath_2 = RelativePath()
rectangle = Rectangle(Plane=PlaneXY(0, 0, 0), XSize=construct_domain_3, YSize=construct_domain_3, Radius=0)  # -> Rectangle, Length; disabled
shadowmaterial = ShadowMaterial(Color=RGB(0, 0, 0), Opacity=1)  # disabled
surface_5 = Surface(rectangle.Rectangle)  # disabled
text_split = TextSplit(Text=relativepath_2, Separators="/")
cull_index = CullIndex(List=text_split, Indices=-1, Wrap=True)
mesh_8 = Mesh(surface_5)  # disabled
mesh_9 = Mesh(Mesh=mesh_8, Material=shadowmaterial, DecimalAccuracy=3)  # disabled
compile_scene = CompileScene(
    Objects=flatten([mesh_7, hempispherelight, ambientlight, spotlight.Light, line, line_4, spaces, mesh_9, envelope, meshvertexcolors, mesh_5, mesh_6]),
    BackgroundColor=ColourSwatch(SwatchColor=RGB(48, 48, 48)),
    Fog=fog)
serializeobject = SerializeObject(Object3d=compile_scene, Minify=False, Run=boolean_toggle)
text_join = TextJoin(Text=cull_index, Join="/")
merge_7 = Merge(Data1=flatten(text_join), Data2=flatten("assets"))  # -> flatten(Result)
text_join_2 = TextJoin(Text=merge_7, Join="/")
boolean_toggle_2 = BooleanToggle(True)
panel_10 = Panel("D:\04_Projects\ucl-grasshopper-web\index.html")
write_text_file = WriteTextFile(Path=text_join_2, FileName="facade.json", Data=serializeobject, Write=boolean_toggle)
httpserver = HTTPServer(Path=text_join, Run=boolean_toggle)

# ==== cluster ShatterParameters
size = ClusterInput()
dimension = ClusterInput()
size_2 = Number(size)
dimension_2 = Number(dimension)
division = Division(A=dimension_2, B=size_2)
round = Round(Number=division)  # -> Nearest, Floor, Ceiling
subtraction = Subtraction(A=division, B=round.Floor)
multiplication = Multiplication(A=size_2, B=subtraction)
expression = Expression(panel=multiplication, surface=dimension_2, Expression="(panel/surface)/2")
x_minus_one = XMinusOne(NumberX=expression)
absolute = Absolute(Value=x_minus_one)
merge = Merge(Data1="0", Data2=expression, Data3=absolute, Data4="1")
floor = ClusterOutput(round.Floor)
result = ClusterOutput(merge)

# ==== cluster Spaces
layer = ClusterInput()
layer_2 = Text(layer)
panel = Panel(layer_2)
elefront_layer = EleFrontLayer(Layer=layer_2)  # -> Layer, FullPath, Hidden, Locked, DisplayColour, MaterialName, Linetype, PrintColour, PrintWidth
reference_by_layer = ReferenceByLayer(LayerName=layer_2, lightweight=False, DisableAutoUpdate=True)
settings_speed = SettingsSpeed()
mesh_brep = MeshBrep(Brep=reference_by_layer, Settings=settings_speed)
meshstandardmaterial = MeshStandardMaterial(
    Color=elefront_layer.DisplayColour,
    Opacity=Slider(0.44, range=0..1),
    Roughness=1,
    Metalness=0.5,
    Emissive=elefront_layer.DisplayColour,
    EmissiveIntensity=1)
userdata = UserData(Keys="level", Values=Slider(0, range=0..100))
mesh = Mesh(Mesh=simplify(mesh_brep), Material=simplify(meshstandardmaterial), DecimalAccuracy=3, UserData=userdata)
geometry = ClusterOutput(mesh)

# ==== cluster Envelope
layer = ClusterInput()
layer_2 = Text(layer)
elefront_layer = EleFrontLayer(Layer=layer_2)  # -> Layer, FullPath, Hidden, Locked, DisplayColour, MaterialName, Linetype, PrintColour, PrintWidth
reference_by_layer = ReferenceByLayer(LayerName=layer_2, lightweight=False, DisableAutoUpdate=True)
settings_speed = SettingsSpeed()
mesh_brep = MeshBrep(Brep=reference_by_layer, Settings=settings_speed)
wireframesettings = WireframeSettings(WireframeLineJoin="round", WireframeLineWidth=1)
meshstandardmaterial = MeshStandardMaterial(
    Color=elefront_layer.DisplayColour,
    Opacity=Slider(0.43, range=0..1),
    Roughness=1,
    Metalness=0.5,
    Emissive=elefront_layer.DisplayColour,
    EmissiveIntensity=1,
    Wireframe=wireframesettings)
userdata = UserData(Keys="level", Values=Slider(0, range=0..100))
mesh_edges = MeshEdges(Mesh=mesh_brep)  # -> flatten(NakedEdges), InteriorEdges, NonManifoldEdges
line = Line()
linebasicmaterial = LineBasicMaterial(Color=RGB(255, 255, 255), LineWidth=1)
line_2 = Line(Line=flatten([mesh_edges.NakedEdges, mesh_edges.InteriorEdges]), LineMaterial=linebasicmaterial, DecimalAccuracy=3)
geometry = ClusterOutput(line_2)

# ==== cluster WorkingSurface
surface = ClusterInput()
parameters_u = ClusterInput()
parameters_v = ClusterInput()
parameter_subdivide_surface = ParameterSubdivideSurface(Surface=surface, ParametersU=parameters_u, ParametersV=parameters_v)
area = Area(Geometry=parameter_subdivide_surface)  # -> Area, Centroid
sort_list = SortList(Keys=area.Area, ValuesValuesA=parameter_subdivide_surface)  # -> Keys, ValuesValuesA
list_item = ListItem(List=sort_list.ValuesValuesA, Index=-1, Wrap=True)
surface_2 = Surface(reparameterize(list_item))
surface_3 = ClusterOutput(surface_2)

# ==== cluster GridLayout
surface = ClusterInput()
u_divisions = ClusterInput()
v_divisions = ClusterInput()
diamond_panels = DiamondPanels(Surface=surface, UDivisions=expr("x*2", u_divisions), VDivisions=v_divisions)  # -> DiamondPanels, TriPanels
surface_2 = Surface(reparameterize(diamond_panels.DiamondPanels))
discontinuity = Discontinuity(Curve=surface_2, Level=1)  # -> simplify(Points), Parameters
list_item = ListItem(List=discontinuity.Points, Index=0, Wrap=True)  # -> Item, Item1, Item2, Item3
merge = Merge(Data1=list_item.Item, Data2=list_item.Item1, Data3=list_item.Item3)
merge_2 = Merge(Data1=list_item.Item2, Data2=list_item.Item1, Data3=list_item.Item3)
polyline = PolyLine(Vertices=reverse(merge_2), Closed=True)
polyline_2 = PolyLine(Vertices=merge, Closed=True)
merge_3 = Merge(Data1=polyline_2, Data2=polyline)
surface_3 = Surface(flatten(merge_3))
renumber_paths = RenumberPaths(Data=surface_3)
renumbered_data = ClusterOutput(renumber_paths)
